# Grasshopper definition Campbell_Maya_CTC-1000_Assingnment 2_Object Generation.gh (Grasshopper 0.9.76)
# plug-ins: Kangaroo2 Components, TSplinesGH

internal_points = Slider(3, range=0..10)

# ---- group: Bouding Box
number_slider = Slider(4, range=0..7)
# Object Genertion
# Requires:
# > T Splines
# > Kangaroo 2
number_slider_2 = Slider(4, range=0..7)
number_slider_3 = Slider(3, range=0..7)

# ---- group: Change for New Points
number_slider_4 = Slider(64, range=0..300)

# ---- group: Use for other types of geometery / Base_Point_Toggle
corner_04 = BooleanToggle(False)
corner_01 = BooleanToggle(True)
corner_02 = BooleanToggle(True)
corner_03 = BooleanToggle(True)

# ---- group: Use for other types of geometery
geo = Geometry()
cluster = Cluster(C=geo, d1=corner_01, d2=corner_02, d3=corner_03, d4=corner_04)
popgeo = PopulateGeometry(Geometry=geo, Count=internal_points, Seed=number_slider_4)
random_internal_points = Panel(popgeo)
merge = Merge(Data1=popgeo, Data2=cluster)
ln = Line(StartPoint=flatten(merge), EndPoint=graft(merge))
dupln = RemoveDuplicateLines(Lines=ln, Tolerance=0.01)
point_interconnections = Panel(dupln)

# ---- group: Base_Point_Toggle
corner_04_2 = BooleanToggle(False)
corner_01_2 = BooleanToggle(True)
corner_02_2 = BooleanToggle(True)
corner_03_2 = BooleanToggle(True)

# ----
rectangle = Rectangle(Plane=PlaneXY(0, 0, 0), XSize=number_slider_2, YSize=number_slider_3, Radius=0)  # -> Rectangle, Length
random_new_seed = RandomNewSeed(S=number_slider_4)

# ----
# Add rectangle base points to the point
# cloud for easier fabrication.
merge_2 = Merge(Data1=corner_01_2, Data2=corner_02_2, Data3=corner_03_2, Data4=corner_04_2)
explode = Explode(Curve=rectangle.Rectangle, Recursive=True)  # -> Segments, Vertices
end = EndPoints(Curve=explode.Segments)  # -> Start, End
cull = CullPattern(List=end.Start, CullPattern=merge_2)

boxrec = BoxRectangle(Rectangle=rectangle.Rectangle, Height=number_slider)
pop3d = Populate3D(Region=boxrec, Count=internal_points, Seed=random_new_seed)
merge_3 = Merge(Data1=pop3d, Data2=cull)
ln_2 = Line(StartPoint=flatten(merge_3), EndPoint=graft(merge_3))  # -> flatten(Line)
dupln_2 = RemoveDuplicateLines(Lines=ln_2, Tolerance=0.01)
other_geometery = Line(dupln)
tpipe = TsPipe(InCurves=dupln_2, DefaultRadius=Slider(0.09, range=0..0.5), JointSet="Bendy", CurveSegments=Slider(2, range=0..10))
final_geometery = Brep(tpipe)

base_point_cull_pattern = Panel(merge_2)
random_internal_points_2 = Panel(pop3d)
point_interconnections_2 = Panel(dupln_2)
generated_object = Panel(final_geometery)

# ==== cluster Cluster
C = ClusterInput()
bbox = BoundingBox(Content=C, Plane=PlaneXY(0, 0, 0))  # -> Box, Box_2
debox = DeconstructBox(Box=bbox.Box)  # -> Plane, X, Y, Z
d1 = ClusterInput()
d2 = ClusterInput()
d3 = ClusterInput()
d4 = ClusterInput()
rectangle = Rectangle(Plane=PlaneXY(0, 0, 0), XSize=debox.X, YSize=debox.Y, Radius=0)  # -> Rectangle, Length
explode = Explode(Curve=rectangle.Rectangle, Recursive=True)  # -> Segments, Vertices
merge = Merge(Data1=d1, Data2=d2, Data3=d3, Data4=d4)
end = EndPoints(Curve=explode.Segments)  # -> Start, End
cull = CullPattern(List=end.Start, CullPattern=merge)
L = ClusterOutput(cull)

# ==== cluster RandomNewSeed
S = ClusterInput()
dom = ConstructDomain(DomainStart=Slider(0, range=0..100), DomainEnd=Slider(1000, range=0..1000))
random = Random(Range=dom, Number=1, Seed=S, Integers=True)
R = ClusterOutput(random)
